# Grasshopper definition monkey_template_v5_grasshopper.gh (Grasshopper 1.0.7)

notchwidth = Slider(3.6, range=1..6)
rectheight = Number(10)
rectangle = Rectangle(Plane=PlaneXY(0, 0, 0), XSize=notchwidth, YSize=rectheight, Radius=0)  # -> Rectangle, Length

rotate = Rotate(Geometry=rectangle.Rectangle, Angle=degrees(Slider(206, range=0..360)), Plane=PlaneXY(0, 0, 0))  # -> Geometry, Transform
vector_xyz = VectorXYZ(XComponent=Slider(37, range=-100..100), YComponent=Slider(-17, range=-100..100), ZComponent=0)  # -> Vector, Length
move = Move(Geometry=rotate.Geometry, Motion=vector_xyz.Vector)  # -> Geometry, Transform

rotate_2 = Rotate(Geometry=rectangle.Rectangle, Angle=degrees(Slider(34, range=0..360)), Plane=PlaneXY(0, 0, 0))  # -> Geometry, Transform
vector_xyz_2 = VectorXYZ(XComponent=Slider(-36, range=-100..100), YComponent=Slider(37, range=-100..100), ZComponent=0)  # -> Vector, Length
move_2 = Move(Geometry=rotate_2.Geometry, Motion=vector_xyz_2.Vector)  # -> Geometry, Transform

rotate_3 = Rotate(Geometry=rectangle.Rectangle, Angle=degrees(Slider(185, range=0..360)), Plane=PlaneXY(0, 0, 0))  # -> Geometry, Transform
vector_xyz_3 = VectorXYZ(XComponent=Slider(13, range=-100..100), YComponent=Slider(-38, range=-100..100), ZComponent=0)  # -> Vector, Length
move_3 = Move(Geometry=rotate_3.Geometry, Motion=vector_xyz_3.Vector)  # -> Geometry, Transform

rotate_4 = Rotate(Geometry=rectangle.Rectangle, Angle=degrees(Slider(178, range=0..360)), Plane=PlaneXY(0, 0, 0))  # -> Geometry, Transform
vector_xyz_4 = VectorXYZ(XComponent=Slider(-11, range=-100..100), YComponent=Slider(-31, range=-100..100), ZComponent=0)  # -> Vector, Length
move_4 = Move(Geometry=rotate_4.Geometry, Motion=vector_xyz_4.Vector)  # -> Geometry, Transform

merge = Merge(Data1=move_2.Geometry, Data2=move_4.Geometry, Data3=move_3.Geometry, Data4=move.Geometry)
body = Curve(<curve referenced from the Rhino model>)
region_difference = RegionDifference(CurvesA=body, CurvesB=merge)

spacing = Slider(66, range=0..200)
duplication = Slider(6, range=0..12)
vector_xyz_5 = VectorXYZ(XComponent=spacing, YComponent=0, ZComponent=0)  # -> Vector, Length
linear_array = LinearArray(Geometry=region_difference, Direction=vector_xyz_5.Vector, Count=duplication)  # -> Geometry, Transform
linear_array_2 = LinearArray(Geometry=region_difference, Direction=vector_xyz_5.Vector, Count=duplication)  # -> Geometry, Transform

spacing_2 = Slider(81, range=0..200)
vector_xyz_6 = VectorXYZ(XComponent=0, YComponent=spacing_2, ZComponent=0)  # -> Vector, Length
move_5 = Move(Geometry=linear_array_2.Geometry, Motion=vector_xyz_6.Vector)  # -> Geometry, Transform
merge_2 = Merge(Data1=linear_array.Geometry, Data2=move_5.Geometry)
