# Grasshopper definition Cylinder.gh (Grasshopper 1.0.7)

# Bottom Piece
cylinder_height = Slider(30, range=0..100)
inner_radius = Slider(17.925, range=0..100)

outer_radius = Slider(40, range=0..100)
cir = Circle(Plane=PlaneXY(0, 0, 0), Radius=outer_radius)
vec = VectorXYZ(XComponent=0, YComponent=0, ZComponent=cylinder_height)  # -> Vector, Length
extr = Extrude(Base=cir, Direction=vec.Vector)
cap = CapHoles(Brep=extr)

# ----
# BigBox
# Bottom Notch Test
# SmallBox
octopus_leg_notch_depth = Slider(12.45, range=0..100)
octopus_leg_notch_width = Slider(3.45, range=0..100)
octopus_leg_notch_length = Slider(23, range=0..100)
rectangle = Rectangle(Plane=PlaneXY(0, 0, 0), XSize=octopus_leg_notch_width, YSize=octopus_leg_notch_depth, Radius=0)  # -> Rectangle, Length
octopus_leg_notch_depth_2 = Slider(24.4, range=0..100)
octopus_leg_notch_width_2 = Slider(6.4, range=0..100)
octopus_leg_notch_length_2 = Slider(26, range=0..100)
rectangle_2 = Rectangle(Plane=PlaneXY(0, 0, 0), XSize=octopus_leg_notch_width_2, YSize=octopus_leg_notch_depth_2, Radius=0)  # -> Rectangle, Length
octopus_leg_notch_width_3 = Slider(6.4, range=0..100)
octopus_leg_notch_width_4 = Slider(1.701, range=0..100)
boxrec = BoxRectangle(Rectangle=rectangle.Rectangle, Height=octopus_leg_notch_length)
boxrec_2 = BoxRectangle(Rectangle=rectangle_2.Rectangle, Height=octopus_leg_notch_length_2)
vec_2 = VectorXYZ(XComponent=octopus_leg_notch_width_4, YComponent=octopus_leg_notch_width_3, ZComponent=0)  # -> Vector, Length
move = Move(Geometry=boxrec, Motion=vec_2.Vector)  # -> Geometry, Transform
sdiff = SolidDifference(BrepsA=boxrec_2, BrepsB=move.Geometry)

number = Slider(0.713, range=0..2)

octopus_leg_notch_depth_3 = Slider(12.45, range=0..100)
multiplierfornotchheight = Slider(0.766, range=0..2)
octopus_leg_notch_width_5 = Slider(3.45, range=0..100)
multiplier = Slider(0.575, range=0..2)
rectangle_3 = Rectangle(Plane=PlaneXY(0, 0, 0), XSize=octopus_leg_notch_width_5, YSize=octopus_leg_notch_depth_3, Radius=0)  # -> Rectangle, Length
multiplication = Multiplication(A=cylinder_height, B=multiplierfornotchheight)
multiplication_2 = Multiplication(A=outer_radius, B=multiplier)
multiplier_2 = Slider(-0.5, range=-2..2)
boxrec_3 = BoxRectangle(Rectangle=rectangle_3.Rectangle, Height=multiplication)
multiplication_3 = Multiplication(A=octopus_leg_notch_width_5, B=multiplier_2)
vec_3 = VectorXYZ(XComponent=multiplication_3, YComponent=multiplication_2, ZComponent=0)  # -> Vector, Length
move_2 = Move(Geometry=boxrec_3, Motion=vec_3.Vector)  # -> Geometry, Transform

outerradius = Slider(63, range=0..100)
cir_2 = Circle(Plane=PlaneXY(0, 0, 0), Radius=outerradius)

# ----
# Just In Case Connector
number_2 = Slider(30, range=0..100)
notchwidth = Slider(3.8, range=0..100)
rectangle_4 = Rectangle(Plane=PlaneXY(0, 0, 0), XSize=notchwidth, YSize=number_2, Radius=0)  # -> Rectangle, Length

multiplication_4 = Multiplication(A=outerradius, B=number)

cir_3 = Circle(Plane=PlaneXY(0, 0, 0), Radius=inner_radius)
vec_4 = VectorXYZ(XComponent=0, YComponent=0, ZComponent=cylinder_height)  # -> Vector, Length
extr_2 = Extrude(Base=cir_3, Direction=vec_4.Vector)
cap_2 = CapHoles(Brep=extr_2)

number_3 = Slider(0.777, range=0..2)
cir_4 = Circle(Plane=PlaneXY(0, 0, 0), Radius=multiplication_4)
multiplication_5 = Multiplication(A=outerradius, B=number_3)
sdiff_2 = SolidDifference(BrepsA=cap, BrepsB=cap_2)
vec_5 = VectorXYZ(XComponent=0, YComponent=multiplication_5, ZComponent=0)  # -> Vector, Length
number_4 = Slider(16, range=0..100)
move_3 = Move(Geometry=rectangle_4.Rectangle, Motion=vec_5.Vector)  # -> Geometry, Transform
arrpolar = PolarArray(Geometry=move_3.Geometry, Plane=PlaneXY(0, 0, 0), Count=number_4, Angle=6.283185307)  # -> Geometry, Transform

arrpolar_2 = PolarArray(Geometry=move_2.Geometry, Plane=PlaneXY(0, 0, 0), Count=Slider(8, range=0..16), Angle=6.283185307)  # -> Geometry, Transform
merge = Merge(Data1=arrpolar_2.Geometry)

sdiff_3 = SolidDifference(BrepsA=sdiff_2, BrepsB=merge)
rdiff = RegionDifference(CurvesA=cir_2, CurvesB=arrpolar.Geometry)
merge_2 = Merge(Data1=rdiff, Data2=cir_4)

# ----
# BigBox
# Top Notch Test
# SmallBox
octopus_leg_notch_depth_4 = Slider(12.2, range=0..100)
octopus_leg_notch_width_6 = Slider(3.2, range=0..100)
octopus_leg_notch_length_3 = Slider(23, range=0..100)
rectangle_5 = Rectangle(Plane=PlaneXY(0, 0, 0), XSize=octopus_leg_notch_width_6, YSize=octopus_leg_notch_depth_4, Radius=0)  # -> Rectangle, Length
octopus_leg_notch_depth_5 = Slider(24.4, range=0..100)
octopus_leg_notch_width_7 = Slider(6.4, range=0..100)
octopus_leg_notch_length_4 = Slider(26, range=0..100)
rectangle_6 = Rectangle(Plane=PlaneXY(0, 0, 0), XSize=octopus_leg_notch_width_7, YSize=octopus_leg_notch_depth_5, Radius=0)  # -> Rectangle, Length
octopus_leg_notch_width_8 = Slider(6.4, range=0..100)
octopus_leg_notch_width_9 = Slider(1.701, range=0..100)
boxrec_4 = BoxRectangle(Rectangle=rectangle_5.Rectangle, Height=octopus_leg_notch_length_3)
boxrec_5 = BoxRectangle(Rectangle=rectangle_6.Rectangle, Height=octopus_leg_notch_length_4)
vec_6 = VectorXYZ(XComponent=octopus_leg_notch_width_9, YComponent=octopus_leg_notch_width_8, ZComponent=0)  # -> Vector, Length
move_4 = Move(Geometry=boxrec_4, Motion=vec_6.Vector)  # -> Geometry, Transform
sdiff_4 = SolidDifference(BrepsA=boxrec_5, BrepsB=move_4.Geometry)

# ----
# Top Piece
cylinder_height_2 = Slider(31, range=0..100)
inner_radius_2 = Slider(17, range=0..100)

outer_radius_2 = Slider(40, range=0..100)
cir_5 = Circle(Plane=PlaneXY(0, 0, 0), Radius=outer_radius_2)
vec_7 = VectorXYZ(XComponent=0, YComponent=0, ZComponent=cylinder_height_2)  # -> Vector, Length
extr_3 = Extrude(Base=cir_5, Direction=vec_7.Vector)
cap_3 = CapHoles(Brep=extr_3)

cir_6 = Circle(Plane=PlaneXY(0, 0, 0), Radius=inner_radius_2)
vec_8 = VectorXYZ(XComponent=0, YComponent=0, ZComponent=cylinder_height_2)  # -> Vector, Length
extr_4 = Extrude(Base=cir_6, Direction=vec_8.Vector)
cap_4 = CapHoles(Brep=extr_4)

multiplier_3 = Slider(0.355, range=-2..2)
multiplication_6 = Multiplication(A=cylinder_height_2, B=multiplier_3)

octopus_leg_notch_depth_6 = Slider(9.45, range=0..100)
multiplier_4 = Slider(0.645, range=0..2)
octopus_leg_notch_width_10 = Slider(3.45, range=0..100)
multiplier_5 = Slider(0.688, range=0..2)
rectangle_7 = Rectangle(Plane=PlaneXY(0, 0, 0), XSize=octopus_leg_notch_width_10, YSize=octopus_leg_notch_depth_6, Radius=0)  # -> Rectangle, Length
multiplication_7 = Multiplication(A=cylinder_height_2, B=multiplier_4)
multiplication_8 = Multiplication(A=outer_radius_2, B=multiplier_5)
multiplier_6 = Slider(-0.5, range=-2..2)
boxrec_6 = BoxRectangle(Rectangle=rectangle_7.Rectangle, Height=multiplication_7)
multiplication_9 = Multiplication(A=octopus_leg_notch_width_10, B=multiplier_6)
vec_9 = VectorXYZ(XComponent=multiplication_9, YComponent=multiplication_8, ZComponent=multiplication_6)  # -> Vector, Length
move_5 = Move(Geometry=boxrec_6, Motion=vec_9.Vector)  # -> Geometry, Transform

sdiff_5 = SolidDifference(BrepsA=cap_3, BrepsB=cap_4)

arrpolar_3 = PolarArray(Geometry=move_5.Geometry, Plane=PlaneXY(0, 0, 0), Count=Slider(16, range=0..32), Angle=6.283185307)  # -> Geometry, Transform
merge_3 = Merge(Data1=arrpolar_3.Geometry)

sdiff_6 = SolidDifference(BrepsA=sdiff_5, BrepsB=merge_3)
