# Grasshopper definition BallJoint_Parameterized.gh (Grasshopper 1.0.7)

extrusionamount = Slider(12, range=0..20)
# InnerTube
innerradius = Slider(1.75, range=0..20)
cir = Circle(Plane=PlaneXY(0, 0, 0), Radius=innerradius)
vec = VectorXYZ(XComponent=0, YComponent=0, ZComponent=extrusionamount)  # -> Vector, Length
multiplication = Multiplication(A=vec.Vector, B=Slider(-1, range=-1..0))
extr = Extrude(Base=cir, Direction=multiplication)
extr_2 = Extrude(Base=cir, Direction=vec.Vector)
merge = Merge(Data1=extr_2, Data2=extr)
cap = CapHoles(Brep=merge)
mesh = Mesh(cap)

# ----
# Sphere
sphereradius = Slider(4.175, range=0..20)
spherepolys = Slider(400, range=0..400)
msphere = MeshSphere(Base=PlaneXY(0, 0, 0), Radius=sphereradius, UCount=spherepolys, VCount=20)

xmove = Slider(24.941, range=0..40)
mdif = MeshDifference(MeshesA=msphere, MeshesB=mesh)
vec_2 = VectorXYZ(XComponent=xmove, YComponent=0, ZComponent=0)  # -> Vector, Length
move = Move(Geometry=mdif, Motion=vec_2.Vector)  # -> Geometry, Transform
